# Grasshopper definition 基盤地図.gh (Grasshopper 0.9.76)

number_slider = Slider(140.087855, range=0..1000)

number_slider_2 = Slider(35.23700439, range=0..100)
number_slider_3 = Slider(136.9352787, range=0..1000)
number_slider_4 = Slider(137.166667, range=0..1000)
number_slider_5 = Slider(36, range=0..100)

number_slider_6 = Slider(36.10377479, range=0..100)
# https://www.gsi.go.jp/sokuchikijun/jpc.html
number_slider_7 = Slider(36, range=0..100)
pt = ConstructPoint(XCoordinate=0, YCoordinate=0, ZCoordinate=0)
path = FilePath("C:\Users\HIROTAKA\Downloads\FG-GML-523657-ALL-20201001\FG-GML-523667-Cntr-20201001-0001_short.xml")
path_2 = FilePath("C:\Users\HIROTAKA\Downloads\FG-GML-523657-ALL-20201001\FG-GML-523657-Cntr-20201001-0001.xml")
panel = Panel(path_2)
path_3 = FilePath("C:\Users\HIROTAKA\Downloads\FG-GML-523657-ALL-20201001\FG-GML-523657-BldA-20201001-0001.xml")
path_4 = FilePath("C:\Users\HIROTAKA\Downloads\FG-GML-523657-ALL-20201001\FG-GML-523657-BldA-20201001-0002.xml")
c_script = CSharpScript(FilePath=path_2, origin=pt, Scale=Slider(0.1, range=0..0.1))  # -> out, Crv, Pt, Type; inputs FilePath: String, origin: Point3d, Scale: Double
# ---------- c_script: C# ----------
    //xmlファイルを指定する
    XElement xml = XElement.Load(FilePath);
    XNamespace ns = xml.Name.Namespace;

    XNamespace ns_gml = "http://www.opengis.net/gml/3.2";
    //↑二つ目以降のnsの取得が分からん、gml

    //cntrタグを探索
    IEnumerable<XElement> infos = from item in xml.Elements(ns + "Cntr")
        select item;

    //リスト作成
    List<Point3d> ContaPt = new List<Point3d>();
    List<Polyline> ContaCrv = new List<Polyline>();
    List<String> TypeStr = new List<String>();


    //cntrごとにループして、コンタのCrvとタイプを処理
    foreach (XElement info in infos)
    {
      XNamespace ns_info = info.Name.Namespace;

      //コンタの高さを取得
      IEnumerable<XElement> elems_alti = info.Descendants(ns_info + "alti");
      float conta_zpt = 0;
      foreach (XElement elem_alti in elems_alti)
      {
        conta_zpt = float.Parse(elem_alti.Value);
      }

      //タイプを取得
      IEnumerable<XElement> elems_type = info.Descendants(ns_info + "type");
      foreach (XElement elem_type in elems_type)
      {
        Print(elem_type.Value);
      }

      //コンタの座標を取得
      IEnumerable<XElement> elems_posList = info.Descendants(ns_gml + "posList");
      foreach (XElement elem_posList in elems_posList)
      {
        StringReader elem_pos = new StringReader(elem_posList.Value);

        Polyline temp_crv = new Polyline();

        //ポイントごとに分割して処理
        while(true)
        {
          String line = elem_pos.ReadLine();

          if(line == string.Empty)
          {

          }
          else if(line != null)
          {
            string[] radxy = line.Split(' ');

            //スケールを調整
            float conta_ypt = float.Parse(radxy[0]);
            float conta_xpt = float.Parse(radxy[1]);
            conta_zpt = conta_zpt;

            Point3d temp_pt = new Point3d(conta_xpt, conta_ypt, conta_zpt);
            ContaPt.Add(temp_pt);


            temp_crv.Add(float.Parse(radxy[0]), float.Parse(radxy[1]), conta_zpt);
            //ContaCrv.Add(temp_crv);
          }
          else if(line == null)
          {
            break;
          }

        }
        Print(temp_crv.ToString());
        ContaCrv.Add(temp_crv);
      }
      //ContaCrv.Add(Polyline(ContaPt));
      //ContaCrv.Add(

    }

    Pt = ContaPt;
    Crv = ContaCrv;
# ---------- end c_script ----------
c_script_2 = CSharpScript(FilePath=path_3)  # -> out, Pt, Crv; inputs FilePath: String
# ---------- c_script_2: C# ----------
    //xmlファイルを指定する
    XElement xml = XElement.Load(FilePath);
    XNamespace ns = xml.Name.Namespace;

    XNamespace ns_gml = "http://www.opengis.net/gml/3.2";
    //↑二つ目以降のnsの取得が分からん、gml

    //BldAタグを探索
    IEnumerable<XElement> infos = from item in xml.Elements(ns + "BldA")
        select item;

    //リスト作成
    List<Point3d> BldPt = new List<Point3d>();
    List<Polyline> BldCrv = new List<Polyline>();
    List<String> TypeStr = new List<String>();


    //cntrごとにループして、コンタのCrvとタイプを処理
    foreach (XElement info in infos)
    {
      XNamespace ns_info = info.Name.Namespace;

      //タイプを取得
      IEnumerable<XElement> elems_type = info.Descendants(ns_info + "type");
      foreach (XElement elem_type in elems_type)
      {
        Print(elem_type.Value);
      }

      //buldingの座標を取得
      IEnumerable<XElement> elems_posList = info.Descendants(ns_gml + "posList");
      foreach (XElement elem_posList in elems_posList)
      {
        StringReader elem_pos = new StringReader(elem_posList.Value);

        Polyline temp_crv = new Polyline();

        //ポイントごとに分割して処理
        while(true)
        {
          String line = elem_pos.ReadLine();

          if(line == string.Empty)
          {

          }
          else if(line != null)
          {
            string[] radxy = line.Split(' ');

            //スケールを調整
            float Bld_ypt = float.Parse(radxy[0]);
            float Bld_xpt = float.Parse(radxy[1]);

            Point3d temp_pt = new Point3d(Bld_xpt, Bld_ypt, 0);
            BldPt.Add(temp_pt);


            temp_crv.Add(Bld_xpt, Bld_ypt, 0);
            //ContaCrv.Add(temp_crv);
          }
          else if(line == null)
          {
            break;
          }

        }
        Print(temp_crv.ToString());
        BldCrv.Add(temp_crv);
      }
      //ContaCrv.Add(Polyline(ContaPt));
      //ContaCrv.Add(

    }

    Pt = BldPt;
    Crv = BldCrv;
# ---------- end c_script_2 ----------

# ---- group: bld_crv
c_script_3 = CSharpScript(FilePath=path_4)  # -> out, Pt, Crv; inputs FilePath: String; same code as c_script_2

# ----
crv = Curve(c_script_2.Crv)
crv_2 = Curve(c_script_3.Crv)
pt_2 = Point(c_script.Pt)
pt_3 = Point(c_script_3.Pt)
crv_3 = Curve(c_script.Crv)
panel_2 = Panel(c_script.out)
pdecon = Deconstruct(Point=c_script_3.Pt)  # -> XComponent, YComponent, ZComponent

# ---- group: 7系補正
c_script_4 = CSharpScript(x=pdecon.XComponent, y=pdecon.YComponent, x_origin=Slider(139.833, range=0..1000), y_origin=number_slider_7)  # -> out, aa, bb; inputs x: Double, y: Double, x_origin: Double, y_origin: Double; disabled
# ---------- c_script_4: C# ----------
    //参考　https://qiita.com/sw1227/items/e7a590994ad7dcd0e8ab
    
    //緯度経路をラジアンに
    double phi_rad = Math.PI * (y) / 180.0;
    double lambda_rad = Math.PI * (x) / 180.0;

    double phi0_rad = Math.PI * (y_origin) / 180.0;
    double lambda0_rad = Math.PI * (x_origin) / 180.0;

    //定数
    double m0 = 0.9999;
    double a = 6378137.0;
    double F = 298.257222101;

    double n = 1.0 / (2 * F - 1);
    double[] A_array = A(n, 6);
    double[] Alpha_array = Alpha(n);
    //double[] Deta_array = Beta(n);
    //double[] Delta_array = Delta(n);

    double A_ = ( (m0 * a) / (1.0 + n) ) * A_array[0];
    
    double[] one_six = {1,2,3,4,5};
    double[] A_array_first = A(n, 5);
    
    double[] Sin_temp = Sin_array(multiply_array(2 * phi0_rad, one_six));
    double[] sums = multiply(A_array_first, Sin_temp);
    double dots = sums.Sum();
    double S_ = ( (m0 * a) / (1.0 + n) ) * ( A_array[0] * phi0_rad +sums.Sum());

    double lambda_c = Math.Cos(lambda_rad - lambda0_rad);
    double lambda_s = Math.Sin(lambda_rad - lambda0_rad);
    
    double t = Math.Sinh(Atanh(Math.Sin(phi_rad)) - ((2 * Math.Sqrt(n)) / (1 + n)) * Atanh(((2 * Math.Sqrt(n)) / (1 + n)) * Math.Sin(phi_rad)));
    double t_ = Math.Sqrt(1 + t * t);
    
    double xi2 = Math.Atan(t / lambda_c);
    double eta2 = Atanh(lambda_s / t_); 
    //eta2 = 0.0035974580637255257;
    
    double[] Sin_temp1 = Sin_array(multiply_array(2 * xi2, one_six));
    double[] Cosh_temp = Cosh_array(multiply_array(2 * eta2, one_six));
    double[] x_multiply = multiply(Alpha_array, multiply(Sin_temp1, Cosh_temp));
    double result_x = A_ * (xi2 + x_multiply.Sum()) - S_;

    double[] Cos_temp = Cos_array(multiply_array(2 * xi2, one_six));
    double[] Sinh_temp = Sinh_array(multiply_array(2 * eta2, one_six));
    double[] y_multiply = multiply(Alpha_array, multiply(Cos_temp, Sinh_temp));
    double result_y = A_ * (eta2 + y_multiply.Sum());
    
    aa = result_x;
    bb = result_y;
# ---------- c_script_4: C# additional code ----------
  public double[] A(double n, double i)
  {
    double A0 = 1 + Math.Pow(n, 2) / 4.0 + Math.Pow(n, 4) / 64.0;
    double A1 = -(3.0 / 2) * ( n - Math.Pow(n, 3) / 8.0 - Math.Pow(n, 5) / 64.0 );
    double A2 = (15.0 / 16) * (  Math.Pow(n, 2) - Math.Pow(n, 4) / 4.0 );
    double A3 = -(35.0 / 48) * (  Math.Pow(n, 3) - (5.0 / 16) * Math.Pow(n, 5) );
    double A4 = (315.0 / 512) * Math.Pow(n, 4);
    double A5 = -(693.0 / 1280) * Math.Pow(n, 5);

    if(i == 6)
    {
      double[] Alpah_array = {A0,A1,A2,A3,A4,A5};
      return Alpah_array;
    }
    else if (i == 5)
    {
      double[] Alpah_array = {A1,A2,A3,A4,A5};
      return Alpah_array;
    }
    else
    {
      double[] Alpah_array = {A0,A1,A2,A3,A4,A5};
      return Alpah_array;
    }
  }
  
  public double[]  Alpha(double n)
  {
    //double a0 = 0;
    double a1 = (1.0 / 2) * n - (2.0 / 3) * Math.Pow(n, 2) + (5.0 / 16) * Math.Pow(n, 3) + (41.0 / 180) * Math.Pow(n, 4) - (127.0 / 288) * Math.Pow(n, 5);
    double a2 = (13.0 / 48) * Math.Pow(n, 2) - (3.0 / 5) * Math.Pow(n, 3) + (557.0 / 1440) * Math.Pow(n, 4) + (281.0 / 630) * Math.Pow(n, 5);
    double a3 = (61.0 / 240) * Math.Pow(n, 3) - (103.0 / 140) * Math.Pow(n, 4) + (15061.0 / 26880) * Math.Pow(n, 5);
    double a4 = (49561.0 / 161280) * Math.Pow(n, 4) - (179.0 / 168) * Math.Pow(n, 5);
    double a5 = (34729.0 / 80640) * Math.Pow(n, 5);

    double[] Alpha_array = { a1, a2, a3, a4, a5};
    return Alpha_array;
  }

  public double[]  Beta(double n)
  {
    double B0 = 0;
    double B1 = (1.0 / 2) * n - (2.0 / 3) * Math.Pow(n, 2) + (37.0 / 96) * Math.Pow(n, 3) - (1.0 / 360) * Math.Pow(n, 4) - (81.0 / 512) * Math.Pow(n, 5);
    double B2 = (1.0 / 48) * Math.Pow(n, 2) + (1.0 / 15) * Math.Pow(n, 3) - (437.0 / 1440) * Math.Pow(n, 4) + (46.0 / 105) * Math.Pow(n, 5);
    double B3 = (17.0 / 480) * Math.Pow(n, 3) - (37.0 / 840) * Math.Pow(n, 4) - (209.0 / 4480) * Math.Pow(n, 5);
    double B4 = (4397.0 / 161280) * Math.Pow(n, 4) - (11.0 / 504) * Math.Pow(n, 5);
    double B5 = (4583.0 / 161280) * Math.Pow(n, 5);

    double[] Beta_array = {B0, B1, B2, B3, B4, B5};
    return Beta_array;
  }

  public double[]  Delta(double n)
  {
    double D0 = 0;
    double D1 = 2.0 * n - (2.0 / 3) * Math.Pow(n, 2) - 2.0 * Math.Pow(n, 3) + (116.0 / 45) * Math.Pow(n, 4) + (26.0 / 45) * Math.Pow(n, 5) - (2854.0 / 675) * Math.Pow(n, 6);
    double D2 = (7.0 / 3) * Math.Pow(n, 2) - (8.0 / 5) * Math.Pow(n, 3) - (227.0 / 45) * Math.Pow(n, 4) + (2704.0 / 315) * Math.Pow(n, 5) + (2323.0 / 945) * Math.Pow(n, 6);
    double D3 = (56.0 / 15) * Math.Pow(n, 3) - (136.0 / 35) * Math.Pow(n, 4) - (1262.0 / 105) * Math.Pow(n, 5) + (73814.0 / 2835) * Math.Pow(n, 6);
    double D4 = (4279.0 / 630) * Math.Pow(n, 4) - (332.0 / 35) * Math.Pow(n, 5) - (399572.0 / 14175) * Math.Pow(n, 6);
    double D5 = (4174.0 / 315) * Math.Pow(n, 5) - (144838.0 / 6237) * Math.Pow(n, 6);
    double D6 = (601676.0 / 22275) * Math.Pow(n, 6);

    double[] Delta_array = {D0, D1, D2, D3, D4, D5, D6};
    return Delta_array;
  }
  
  public double Atanh(double n)
  {
    return (Math.Log((1 + n) / (1 - n)) / 2);
    //return Math.Atanh(n);
  }
  
  public double[] multiply(double[] n, double[] m)
  {
    double[] multy_array = new double[n.Length]; 
    for (int i = 0; i < n.Length; i++)
    {
      multy_array[i] = n[i] * m[i];
    }
    return multy_array;
  }
  
  public double[] multiply_array(double n, double[] m)
  {
    double[] multy_array = new double[m.Length]; 
    for (int i = 0; i < m.Length; i++)
    {
      multy_array[i] = n * m[i];
    }
    return multy_array;
  }

  public double[] Sin_array(double[] m)
  {
    double[] multy_array = new double[m.Length]; 
    for (int i = 0; i < m.Length; i++)
    {
      multy_array[i] = Math.Sin(m[i]);
    }
    return multy_array;
  }
  
  public double[] Cosh_array(double[] m)
  {
    double[] multy_array = new double[m.Length]; 
    for (int i = 0; i < m.Length; i++)
    {
      multy_array[i] = Math.Cosh(m[i]);
    }
    return multy_array;
  }
  
  public double[] Cos_array(double[] m)
  {
    double[] multy_array = new double[m.Length]; 
    for (int i = 0; i < m.Length; i++)
    {
      multy_array[i] = Math.Cos(m[i]);
    }
    return multy_array;
  }
  
  public double[] Sinh_array(double[] m)
  {
    double[] multy_array = new double[m.Length]; 
    for (int i = 0; i < m.Length; i++)
    {
      multy_array[i] = Math.Sinh(m[i]);
    }
    return multy_array;
  }
  
  public double[] ArrayPrint(double[] m)
  {
    double[] multy_array = new double[m.Length]; 
    Print("[");
    for (int i = 0; i < m.Length; i++)
    {
      Print(m[i].ToString());
    }
    Print("]");
    return multy_array;
  }
  
  public double dot(double[] m)
  {
    double multy_array = 1; 
    for (int i = 0; i < m.Length; i++)
    {
      multy_array = multy_array * m[i];
    }
    return multy_array;
  }
  /// <summary>
  /// This method will be called once every solution, before any calls to RunScript.
  /// </summary>
  public override void BeforeRunScript()
  { }
  /// <summary>
  /// This method will be called once every solution, after any calls to RunScript.
  /// </summary>
  public override void AfterRunScript()
  { }
# ---------- end c_script_4 ----------

# ----
panel_3 = Panel(c_script_4.aa)
panel_4 = Panel(c_script_4.bb)
pt_4 = ConstructPoint(XCoordinate=c_script_4.aa, YCoordinate=c_script_4.bb, ZCoordinate=0)
panel_5 = Panel(c_script_3.Pt)
panel_6 = Panel(c_script.Crv)
panel_7 = Panel(pt_4)
