# Grasshopper definition point2point.gh (Grasshopper 0.9.76)

number_slider = Slider(10, range=0..10)
rec = Rectangle({Plane=PlaneXY(-36.84556868, -19.726285, 0), Size=Domain2(u=0..67.40821162, v=0..41.58591229)})
pt = Point(<point referenced from the Rhino model>)
pop2d = Populate2D(Region=rec, Count=Slider(78, range=0..100), Seed=1)
c_script = CSharpScript(points=pop2d, item_origin=pt)  # -> out, A; inputs points: list of Point3d, item_origin: Point3d, item: list of GeometryBase
# ---------- c_script: C# ----------
    List<Vector3d> move = new List<Vector3d>();
    foreach(Point3d temp_point in points)
    {
      Vector3d temp_vector = new Vector3d((temp_point.X - item_origin.X), (temp_point.Y - item_origin.Y), (temp_point.Z - item_origin.Z));
      move.Add(temp_vector);
    }

    int step = 0;
    DataTree<GeometryBase> output = new DataTree<GeometryBase>();
    foreach(Vector3d temp_vector in move)
    {

      Transform movement = Transform.Translation(temp_vector);

      GH_Path ghp = new GH_Path(step);

      foreach(GeometryBase geo in item)
      {
        GeometryBase geo_temp = geo.Duplicate();
        geo_temp.Transform(movement);
        output.Add(geo_temp, ghp);
        geo_temp = null;
      }
      step = step + 1;

    }
    Print(output.ToString());
    A = output;
# ---------- end c_script ----------
c_script_2 = CSharpScript()  # -> Out, A
panel = Panel(c_script.A)
panel_2 = Panel(c_script.out)
